# Grasshopper definition ReadImgFromJson.gh (Grasshopper 0.9.75)
# plug-ins: Python Interpreter

file = ReadFile(File="C:\Data\DefMaster_results.json", PerLineParse=True)
readjson = PythonScript(x=file)  # -> out, a, b
# ---------- readjson: Python ----------
import json
dict = json.loads(x)
keys = []
vals = []
for key in dict:
     keys.append(key)
     vals.append(dict[key])
a = keys
b = vals
# ---------- end readjson ----------
fsim = FindSimilarMember(Data="capture", Set=readjson.a)  # -> Hit, Index
item = ListItem(List=readjson.b, Index=fsim.Index, Wrap=True)
c_script = CSharpScript(x=item)  # -> out, A; inputs x: String
# ---------- c_script: C# ----------
    byte[] array = Convert.FromBase64String(x);
    System.ComponentModel.TypeConverter tc = System.ComponentModel.TypeDescriptor.GetConverter(typeof(Bitmap));
    Bitmap bitmap1 = (Bitmap) tc.ConvertFrom(array);
    bitmap1.Save(@"C:\data\imgTest.jpg");
# ---------- end c_script ----------
